# Grasshopper definition Before_Live_Solid.gh (Grasshopper 1.0.8)

number_slider = Slider(14, range=0..22)
construct_domain = ConstructDomain(DomainStart=Slider(-4, range=-5..10), DomainEnd=Slider(4, range=-5..10))
circle = Circle(Plane=PlaneXY(0, 0, 0), Radius=Slider(22, range=0..22))
construct_domain_2 = ConstructDomain(DomainStart=Slider(-5, range=-5..10), DomainEnd=Slider(5, range=-5..10))
construct_domain_3 = ConstructDomain(DomainStart=0, DomainEnd=1)
construct_domain_4 = ConstructDomain(DomainStart=0, DomainEnd=5)
divide_curve = DivideCurve(Curve=circle, Count=number_slider, Kinks=False)  # -> Points, Tangents, Parameters

# ---- group: ORGANIC RING | NON-RECTANGULAR UV -> VORONOI -> SQUISHBACK
# NON-RECTANGULAR UV / SQUISH WORKFLOW
# Populate -> Voronoi -> clip to real UV boundary -> Scale + Fillet -> SquishBack.
# Cell count / Pattern seed / Hole scale / Corner radius control the pattern.
# Squish data is required. These outputs are curves, ready for surface cutting.
# Current dimensions are preserved.
uvsurface = Surface(<surface referenced from the Rhino model>)
cell_count = Slider(24, range=8..150)
pattern_seed = Slider(6, range=0..100)
populate_geometry = PopulateGeometry(Geometry=uvsurface, Count=cell_count, Seed=pattern_seed)
uv_boundary = UVBoundary(U=uvsurface)  # -> out, Boundary, Bounds
# ---------- uv_boundary: Python ----------
import Rhino.Geometry as rg
import System
import rhinoscriptsyntax as rs

def geom(x):
    if hasattr(x, 'Value'): x = x.Value
    if isinstance(x, System.Guid): x = rs.coercebrep(x)
    if isinstance(x, rg.Surface): x = x.ToBrep()
    return x

b = geom(U)
if b is None: raise ValueError('Connect the existing squished UVSurface.')
Boundary = list(rg.Curve.JoinCurves(b.DuplicateNakedEdgeCurves(True, False), 0.001))
box = b.GetBoundingBox(True)
box.Inflate(1.0)
Bounds = rg.Rectangle3d(rg.Plane.WorldXY, rg.Interval(box.Min.X, box.Max.X), rg.Interval(box.Min.Y, box.Max.Y))
ghenv.Component.Message = 'Actual UV outline'
# ---------- end uv_boundary ----------
voronoi = Voronoi(Points=populate_geometry, Boundary=uv_boundary.Bounds, BruteForceOverride=False)
clip_to_uv = RegionIntersection(CurvesA=graft(voronoi), CurvesB=flatten(uv_boundary.Boundary))
hole_scale = Slider(0.76, range=0.3..0.95)
area = Area(Geometry=clip_to_uv)  # -> Area, Centroid
corner_radius_mm = Slider(1, range=0..4)
scale = Scale(Geometry=clip_to_uv, Center=area.Centroid, Factor=hole_scale)  # -> Geometry, Transform
fillet = Fillet(Curve=scale.Geometry, Radius=corner_radius_mm)
squish_back_to_ring = SquishBackToRing(U=uvsurface, Cells=flatten(clip_to_uv), Holes=flatten(fillet))  # -> out, Cells3D, Holes3D, Report; inputs Cells: list, Holes: list
# ---------- squish_back_to_ring: Python ----------
import Rhino.Geometry as rg
import Rhino
import System
import rhinoscriptsyntax as rs
from System.Collections.Generic import List

def geom(x):
    if hasattr(x, 'Value'): x = x.Value
    if isinstance(x, System.Guid): x = rs.coercegeometry(x)
    return x

b = geom(U)
if isinstance(b, rg.Surface): b = b.ToBrep()
if not rg.Squisher.Is2dPatternSquished(b):
    raise ValueError('U must retain Squish data. Reference the original Squish surface, not a rebuilt boundary surface.')

def back(items):
    curves = [geom(x) for x in items if x is not None]
    result = rg.Squisher.SquishBack2dMarks(b, List[rg.GeometryBase](curves))
    if result is None: raise ValueError('SquishBack failed. Check the source surface.')
    result = list(result)
    if any(x is None for x in result):
        raise ValueError('A curve could not map. Check that every curve lies inside the UV boundary.')
    return result

Cells3D = back(Cells)
Holes3D = back(Holes)
Report = '{} Voronoi cells + {} rounded hole curves mapped to original model.'.format(len(Cells3D),len(Holes3D))
ghenv.Component.Message = 'SquishBack | {} holes'.format(len(Holes3D))
# ---------- end squish_back_to_ring ----------
panel = Panel(squish_back_to_ring.Report)
voronoi_on_ring = Curve(squish_back_to_ring.Cells3D)
rounded_holes_on_ring = Curve(squish_back_to_ring.Holes3D)

# ----
randoma = Random(Range=construct_domain, Number=number_slider, Seed=Slider(5, range=0..22))
random = Random(Range=construct_domain_2, Number=number_slider, Seed=Slider(15, range=0..22))
unit_z = UnitZ(Factor=randoma)
unit_z_2 = UnitZ(Factor=random)
rectangle = Rectangle(Plane=PlaneXY(0, 0, 0), XSize=construct_domain_4, YSize=construct_domain_3, Radius=0)  # -> Rectangle, Length
move = Move(Geometry=divide_curve.Points, Motion=unit_z)  # -> Geometry, Transform
move_2 = Move(Geometry=divide_curve.Points, Motion=unit_z_2)  # -> Geometry, Transform
populate_2d = Populate2D(Region=rectangle.Rectangle, Count=Slider(3, range=0..22), Seed=1)
boolean = Boolean(True)
boolean_2 = Boolean(True)
interpolate = Interpolate(Vertices=move.Geometry, Degree=3, Periodic=boolean_2, KnotStyle=1)  # -> Curve, Length, Domain
voronoi_2 = Voronoi(Points=populate_2d, Boundary=rectangle.Rectangle, BruteForceOverride=False)
interpolate_2 = Interpolate(Vertices=move_2.Geometry, Degree=3, Periodic=boolean, KnotStyle=1)  # -> Curve, Length, Domain
unit_z_3 = UnitZ(Factor=Slider(15, range=0..22))
fillet_2 = Fillet(Curve=voronoi_2, Radius=Slider(1.648, range=0..2))
move_3 = Move(Geometry=interpolate_2.Curve, Motion=unit_z_3)  # -> Geometry, Transform
area_2 = Area(Geometry=fillet_2)  # -> Area, Centroid
merge = Merge(Data1=interpolate.Curve, Data2=move_3.Geometry)
scale_2 = Scale(Geometry=fillet_2, Center=area_2.Centroid, Factor=Slider(0.452, range=0..1))  # -> Geometry, Transform
loft = Loft(Curves=merge, Options={Adjust=False, Closed=False, LoftEnds=0, LoftSimp=0, LoftType=0, Rebuild=10, Refit=0.01})
region_difference = RegionDifference(CurvesA=rectangle.Rectangle, CurvesB=scale_2.Geometry)
surface = Surface(loft)
boundary_surfaces = BoundarySurfaces(Edges=region_difference)
map_to_surface = MapToSurface(Curve=scale_2.Geometry, Source=boundary_surfaces, Target=surface)
surface_split = SurfaceSplit()
area_3 = Area(Geometry=surface_split)  # -> Area, Centroid
sort_list = SortList(Keys=area_3.Area, ValuesA=surface_split)  # -> Keys, ValuesA
list_item = ListItem(List=sort_list.ValuesA, Index=Slider(28, range=0..50), Wrap=True)
boolean_3 = Boolean(True)
offset_surface = OffsetSurface(Surface=list_item, Distance=Slider(2.5, range=0..5), Retrim=boolean_3)
