# Grasshopper definition Original_UV_Populate.gh (Grasshopper 1.0.8)

number_slider = Slider(14, range=0..22)
construct_domain = ConstructDomain(DomainStart=Slider(-4, range=-5..10), DomainEnd=Slider(4, range=-5..10))
circle = Circle(Plane=PlaneXY(0, 0, 0), Radius=Slider(22, range=0..22))
construct_domain_2 = ConstructDomain(DomainStart=Slider(-5, range=-5..10), DomainEnd=Slider(5, range=-5..10))
construct_domain_3 = ConstructDomain(DomainStart=0, DomainEnd=1)
construct_domain_4 = ConstructDomain(DomainStart=0, DomainEnd=5)
divide_curve = DivideCurve(Curve=circle, Count=number_slider, Kinks=False)  # -> Points, Tangents, Parameters
uvsurface = Surface(<surface referenced from the Rhino model>)
randoma = Random(Range=construct_domain, Number=number_slider, Seed=Slider(5, range=0..22))
random = Random(Range=construct_domain_2, Number=number_slider, Seed=Slider(15, range=0..22))
unit_z = UnitZ(Factor=randoma)
unit_z_2 = UnitZ(Factor=random)
rectangle = Rectangle(Plane=PlaneXY(0, 0, 0), XSize=construct_domain_4, YSize=construct_domain_3, Radius=0)  # -> Rectangle, Length
populate_geometry = PopulateGeometry(Geometry=uvsurface, Count=100, Seed=1)
move = Move(Geometry=divide_curve.Points, Motion=unit_z)  # -> Geometry, Transform
move_2 = Move(Geometry=divide_curve.Points, Motion=unit_z_2)  # -> Geometry, Transform
populate_2d = Populate2D(Region=rectangle.Rectangle, Count=Slider(3, range=0..22), Seed=1)
boolean = Boolean(True)
boolean_2 = Boolean(True)
interpolate = Interpolate(Vertices=move.Geometry, Degree=3, Periodic=boolean_2, KnotStyle=1)  # -> Curve, Length, Domain
voronoi = Voronoi(Points=populate_2d, Boundary=rectangle.Rectangle, BruteForceOverride=False)
interpolate_2 = Interpolate(Vertices=move_2.Geometry, Degree=3, Periodic=boolean, KnotStyle=1)  # -> Curve, Length, Domain
unit_z_3 = UnitZ(Factor=Slider(15, range=0..22))
fillet = Fillet(Curve=voronoi, Radius=Slider(1.648, range=0..2))
move_3 = Move(Geometry=interpolate_2.Curve, Motion=unit_z_3)  # -> Geometry, Transform
area = Area(Geometry=fillet)  # -> Area, Centroid
merge = Merge(Data1=interpolate.Curve, Data2=move_3.Geometry)
scale = Scale(Geometry=fillet, Center=area.Centroid, Factor=Slider(0.452, range=0..1))  # -> Geometry, Transform
loft = Loft(Curves=merge, Options={Adjust=False, Closed=False, LoftEnds=0, LoftSimp=0, LoftType=0, Rebuild=10, Refit=0.01})
region_difference = RegionDifference(CurvesA=rectangle.Rectangle, CurvesB=scale.Geometry)
surface = Surface(loft)
boundary_surfaces = BoundarySurfaces(Edges=region_difference)
map_to_surface = MapToSurface(Curve=scale.Geometry, Source=boundary_surfaces, Target=surface)
surface_split = SurfaceSplit()
area_2 = Area(Geometry=surface_split)  # -> Area, Centroid
sort_list = SortList(Keys=area_2.Area, ValuesA=surface_split)  # -> Keys, ValuesA
list_item = ListItem(List=sort_list.ValuesA, Index=Slider(28, range=0..50), Wrap=True)
boolean_3 = Boolean(True)
offset_surface = OffsetSurface(Surface=list_item, Distance=Slider(2.5, range=0..5), Retrim=boolean_3)
